# Grasshopper definition add_tack_gh_poc.ghx (Grasshopper 1.0.8)

# ---- group: Parent Brep: bb1fcdc0
brep = Brep(<brep referenced from the Rhino model>)

# ---- group: Parent vertex index: 5
int = Integer(5)

# ---- group: Child Brep: 74acd55e
brep_2 = Brep(<brep referenced from the Rhino model>)

# ---- group: Child Model Object for Content Cache: 74acd55e
object = ModelObject(<model object referenced from the Rhino model>)

# ---- group: Child vertex index: 2
int_2 = Integer(2)

# ---- group: Stored initial vector: (40.266, -22.001, 9.631)
vec = Vector(Vector(40.26581444, -22.00083056, 9.631420317))

# ---- group: Parent: deconstruct Brep
# Native Content Cache owns child write-back.
# Python only creates/expires the hidden GH document.
debrep = DeconstructBrep(Brep=brep)  # -> Faces, Edges, Vertices

# ---- group: Parent: list item from vertices
item = ListItem(List=debrep.Vertices, Index=int, Wrap=True)

# ---- group: Child: deconstruct Brep
debrep_2 = DeconstructBrep(Brep=brep_2)  # -> Faces, Edges, Vertices

# ---- group: Child: list item from vertices
item_2 = ListItem(List=debrep_2.Vertices, Index=int_2, Wrap=True)

# ---- group: Target child anchor = parent anchor + stored vector
move = Move(Geometry=item, Motion=vec)  # -> Geometry, Transform

# ---- group: Correction vector = child anchor -> target anchor
vec2pt = Vector2Pt(PointA=item_2, PointB=move.Geometry, Unitize=False)  # -> Vector, Length

# ---- group: Move child geometry by correction
move_2 = Move(Geometry=brep_2, Motion=vec2pt.Vector)  # -> Geometry, Transform

# ---- group: Model Object combines child identity with moved geometry
object_2 = ModelObject(Object=object, Geometry=move_2.Geometry)  # -> Object, Geometry, Name, Layer, Visibility, Display, Drafting, Render

# ---- group: Content Cache Push writes child geometry
cache = ContentCache(Content=object_2.Object, Action=null)
